% Simulink data dictionary Base_Model.sldd

g = Simulink.Parameter(9.81, StorageClass="ExportedGlobal", DataType="double")
Carrier_Mass = Simulink.Parameter(0.01, StorageClass="ExportedGlobal", DataType="double")
Cable_Damping = Simulink.Parameter(0.1, StorageClass="ExportedGlobal", DataType="double")
Cable_Stiffness = Simulink.Parameter(500, StorageClass="ExportedGlobal", DataType="double")
Load_Mass = Simulink.Parameter(0.7, StorageClass="ExportedGlobal", DataType="double")
Cable_Resting_Length = Simulink.Parameter(0.8, StorageClass="ExportedGlobal", DataType="double")
Load_Damping_Coef = Simulink.Parameter(1, StorageClass="ExportedGlobal", DataType="double")
Attachment_Point_Vectors = Simulink.Parameter([1 1 0 -1 1 0 -1 -1 0 1 -1 0], StorageClass="ExportedGlobal", DataType="double")
Load_Inertia_Matrix = Simulink.Parameter([0.01 0 0 0 0.01 0 0 0 0.01], StorageClass="ExportedGlobal", DataType="double")
Kpc = Simulink.Parameter(10, StorageClass="ExportedGlobal", DataType="double")
Kdc = Simulink.Parameter(0.001, StorageClass="ExportedGlobal", DataType="double")